# Grasshopper definition 0-recipe.gh (Grasshopper 1.0.7)

ingrediente1 = Point()
ingrediente2 = Point()
ingrediente3 = Point()
ingrediente4 = Point()
ingrediente5 = Point()
ingrediente6 = Point()
mezclar = Line(StartPoint=ingrediente1, EndPoint=ingrediente2)
hornear = DivideDistance(Curve=mezclar, Distance=Slider(8, range=0..10))  # -> Points, Tangents, Parameters
rellenar = Line(StartPoint=hornear.Points, EndPoint=[ingrediente3, ingrediente4, ingrediente5, ingrediente6, ingrediente2])
hornear_2 = DivideDistance(Curve=rellenar, Distance=Slider(30, range=0..100))  # -> Points, Tangents, Parameters
comida = Line(hornear_2.Points)
