# Grasshopper definition 17-eval.gh (Grasshopper 1.0.7)

y_scale = Slider(2, range=0..10)
x_scale = Slider(3, range=0..10)
frequency = Slider(2, range=0..10)
phase = Slider(0, range=0..2)
periods = Slider(6, range=0..10)
resolution = Slider(200, range=0..1000)
y_scale_2 = Slider(3, range=0..10)
x_scale_2 = Slider(3, range=0..10)
frequency_2 = Slider(2, range=0..10)
resolution_2 = Slider(200, range=0..1000)
phase_2 = Slider(0, range=0..2)
periods_2 = Slider(6, range=0..10)
crv = Curve(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)
pi = Pi(Factor=phase_2)
pi_2 = Pi(Factor=periods_2)
pi_3 = Pi(Factor=phase)
pi_4 = Pi(Factor=periods)
range = Range(Domain=pi_4, Steps=resolution)
range_2 = Range(Domain=pi_2, Steps=resolution_2)
eval = Evaluate(F="A*sin(f*t+r)", A=y_scale, f=frequency, r=pi_3, t=range)
eval_2 = Evaluate(F="A*sin(f*t+r)", A=y_scale_2, f=frequency_2, r=pi, t=range_2)
multiplication = Multiplication(A=x_scale, B=range)
multiplication_2 = Multiplication(A=x_scale_2, B=range_2)
pt = ConstructPoint(XCoordinate=multiplication, YCoordinate=eval, ZCoordinate=0)
pline = PolyLine(Vertices=pt, Closed=False)
pt_2 = ConstructPoint(XCoordinate=0, YCoordinate=0, ZCoordinate=0)
cluster = Cluster(s=y_scale_2, x=eval_2, X=multiplication_2, C=crv, N=resolution_2)  # -> pt_3, pt_4
divide = DivideCurve(Count=10, Kinks=False)  # -> Points, Tangents, Parameters
pdecon = Deconstruct()  # -> XComponent, YComponent, ZComponent
eval_3 = Evaluate()
pline_2 = PolyLine(Vertices=cluster.pt_3, Closed=False)
pline_3 = PolyLine(Vertices=cluster.pt_4, Closed=False)

# ==== cluster Cluster
C = ClusterInput()
N = ClusterInput()
divide = DivideCurve(Curve=C, Count=N, Kinks=False)  # -> Points, Tangents, Parameters
s = ClusterInput()
x = ClusterInput()
eval = Evaluate(F="If(x>=0, s, -s)", s=s, x=x)
pdecon = Deconstruct(Point=divide.Points)  # -> XComponent, YComponent, ZComponent
X = ClusterInput()
pt = ConstructPoint(XCoordinate=X, YCoordinate=0, ZCoordinate=eval)
pt_2 = ConstructPoint(XCoordinate=pdecon.XComponent, YCoordinate=pdecon.YComponent, ZCoordinate=eval)
pt_3 = ClusterOutput(pt)
pt_4 = ClusterOutput(pt_2)
