# Grasshopper definition 1-volumencilindro.gh (Grasshopper 0.9.80)

radio = Slider(1, range=0..1)
alçada = Slider(2, range=0..10)
cluster = Cluster(x=radio, B=alçada)
panel = Panel(cluster)

# ==== cluster Cluster
x = ClusterInput()
B = ClusterInput()

# ---- group: 1 volumen del cilindro
pi = Pi(Factor=1)
sqr = Square(Value=x)
multiplication = Multiplication(A=sqr, B=pi)
multiplication_2 = Multiplication(A=multiplication, B=B)

# ----
result = ClusterOutput(multiplication_2)
