# Grasshopper definition 2-alturacilindro.gh (Grasshopper 0.9.80)

diametre = Slider(1, range=0..1)
volumen = Slider(6.283, range=0..10)
cluster = Cluster(x=diametre, A=volumen)
panel = Panel(cluster)

# ==== cluster Cluster
x = ClusterInput()
sqr = Square(Value=x)
pi = Pi(Factor=1)
multiplication = Multiplication(A=sqr, B=pi)
A = ClusterInput()
division = Division(A=A, B=multiplication)
R = ClusterOutput(division)
