# Grasshopper definition 3-area-triangulorectangulo.gh (Grasshopper 0.9.80)

point = Point(Point(70, 20, 0))
point_2 = Point(Point(20, 20, 0))
point_3 = Point(Point(50, 50, 0))
cluster = Cluster(point=point_2, point_2=point, point_3=point_3)
panel = Panel(cluster)

# ==== cluster Cluster
point = ClusterInput()
point_2 = ClusterInput()
point_3 = ClusterInput()
deconstruct = Deconstruct(Point=point)  # -> XComponent, YComponent, ZComponent
deconstruct_2 = Deconstruct(Point=point_2)  # -> XComponent, YComponent, ZComponent
deconstruct_3 = Deconstruct(Point=point_3)  # -> XComponent, YComponent, ZComponent
# base
subtraction = Subtraction(A=deconstruct.XComponent, B=deconstruct_2.XComponent)
# altura
subtraction_2 = Subtraction(A=deconstruct_2.YComponent, B=deconstruct_3.YComponent)
multiplication = Multiplication(A=subtraction, B=subtraction_2)
division = Division(A=multiplication, B=Slider(2, range=0..10))
result = ClusterOutput(division)
