# Grasshopper definition 9-slantedgrid.gh (Grasshopper 0.9.80)

crv = Curve(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)
crv_2 = Curve(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)
cluster = Cluster(geometry=crv, curve=crv_2, steps=Slider(4, range=0..10), geometry_2=crv_2, step=Slider(2, range=0..100))  # -> geometry_3, geometry_4
curve = Curve(cluster.geometry_3)
curve_2 = Curve(cluster.geometry_4)

# ==== cluster Cluster
geometry = ClusterInput()
steps = ClusterInput()
curve = ClusterInput()
geometry_2 = ClusterInput()
step = ClusterInput()
length = Length(Curve=curve)
range = Range(Domain=length, Steps=steps)
unit_x = UnitX(Factor=range)
move = Move(Geometry=geometry, Motion=unit_x)  # -> Geometry, Transform
geometry_3 = ClusterOutput(move.Geometry)
evaluate_curve = EvaluateCurve(Curve=move.Geometry, Parameter=Slider(0, range=0..100))  # -> Point, Tangent, Angle
series = Series(Start=0, Step=step, Count=10)
multiplication = Multiplication(A=evaluate_curve.Tangent, B=series)
move_2 = Move(Geometry=geometry_2, Motion=multiplication)  # -> Geometry, Transform
geometry_4 = ClusterOutput(move_2.Geometry)
