# Grasshopper definition 1.gh (Grasshopper 0.9.76)

crv = Curve(<curve referenced from the Rhino model>)

# ---- group: divide the curve in N segments
divide = DivideCurve(Curve=crv, Count=Slider(39, range=5..50), Kinks=False)  # -> Points, Tangents, Parameters

# ---- group: get the cords of each point
deconstruct = Deconstruct(Point=divide.Points)  # -> XComponent, YComponent, ZComponent

# ---- group: create a pattern ofr the z axis
lng = ListLength(List=deconstruct.ZComponent)
series = Series(Start=0, Step=5, Count=2)
repeat = RepeatData(Data=series, Length=lng)
addition = Addition(A=repeat, B=10)

# ---- group: only two decimals
max_decimal_places = Slider(1, range=0..10)
eval = Evaluate(F="Round(x,y)", x=deconstruct.YComponent, y=max_decimal_places)
eval_2 = Evaluate(F="Round(x,y)", x=addition, y=max_decimal_places)
eval_3 = Evaluate(F="Round(x,y)", x=deconstruct.XComponent, y=max_decimal_places)

# ---- group: a random pattern?
random = Random(Range=Slider(5, range=1..10), Number=lng, Seed=2)

# ---- group: take the coords and produce a gcode line in text format
panel = Panel("G0 or G1 ?")
addition_2 = Addition(A=eval_2, B=10)
format = Format(Format="G0 X{0} Y{1} Z{2}", Culture=127, Data0=eval_3, Data1=eval, Data2=addition_2)

# ----
pt = ConstructPoint(XCoordinate=eval_3, YCoordinate=eval, ZCoordinate=eval_2)

# ---- group: cnc gcode (3 axis) / speed (feed rate)
panel_2 = Panel(" F200")

# ---- group: 3d printer gcode (3 axis, no extruder) / speed (feed rate)
panel_3 = Panel(" F3000")

# ---- group: 3d printer gcode (3 axis, no extruder)
concat = Concatenate(FragmentA=format, FragmentB=panel_3)  # -> flatten(Result)
pre_pend_gcode = Panel("""G28
G21 ; en mm
G90 ;absolute positioning""")
post_pend_gcode = Panel("G28")
panel_4 = Panel(concat)
merge = Merge(Data1=pre_pend_gcode, Data2=panel_4, Data3=post_pend_gcode)
panel_5 = Panel(merge)

# ---- group: cnc gcode (3 axis)
concat_2 = Concatenate(FragmentA=format, FragmentB=panel_2)  # -> flatten(Result)
pre_pend_gcode_2 = Panel("""%
G90 
G54 
S1000 
M3 
G4 P2""")
cnc_gcode_3_axis = Panel(concat_2)
post_pend_gcode_2 = Panel("""M5 
G53 X0 Y0 Z0
%""")
merge_2 = Merge(Data1=pre_pend_gcode_2, Data2=cnc_gcode_3_axis, Data3=post_pend_gcode_2)
panel_6 = Panel(merge_2)
