# Grasshopper definition 3_axis_DRY_3Dprinter_GCODE_GENERATOR_template.gh (Grasshopper 1.0.7)

# ---- group: generate a toolpath (a set of ordered points )
crv = Curve(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)
crv_2 = Curve(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)
divide = DivideCurve(Curve=crv, Count=Slider(6, range=0..10), Kinks=False)  # -> Points, Tangents, Parameters
divide_2 = DivideCurve(Curve=crv_2, Count=Slider(6, range=0..10), Kinks=False)  # -> Points, Tangents, Parameters
weave = Weave(Pattern=[0, 1], Stream0=divide_2.Points, Stream1=divide.Points, NullGaps=False)

# ----
points_tripples_of_coordinates = Panel(weave)

# ---- group: get the cords of each point
deconstruct = Deconstruct(Point=weave)  # -> XComponent, YComponent, ZComponent

# ---- group: round the point coords to only one decimal
max_decimal_places = Slider(1, range=0..10)
eval = Evaluate(F="Round(x,y)", x=deconstruct.YComponent, y=max_decimal_places)
eval_2 = Evaluate(F="Round(x,y)", x=deconstruct.ZComponent, y=max_decimal_places)
eval_3 = Evaluate(F="Round(x,y)", x=deconstruct.XComponent, y=max_decimal_places)

# ---- group: take the coords and produce a gcode line in text format
# G0 is move to fast speed
# G1 is move at feed rate for cutting
panel = Panel("G1 X{0} Y{1} Z{2}")
format = Format(Format=panel, Culture=127, Data0=eval_3, Data1=eval, Data2=eval_2)

# ---- group: just to preview final toolpath points
pt = ConstructPoint(XCoordinate=eval_3, YCoordinate=eval, ZCoordinate=eval_2)
order = PointOrder(Points=pt)

# ---- group: DRY (no heating!) 3d printer gcode (3 axis) / speed (feed rate)
panel_2 = Panel(" F1000")

# ---- group: DRY (no heating!) 3d printer gcode (3 axis)
concat = Concatenate(FragmentA=format, FragmentB=panel_2)  # -> flatten(Result)
pre_pend_gcode = Panel("""G28 ; home
G21 ; en mm
G90 ; absolute positioning""")
cnc_gcode_3_axis = Panel(concat)
post_pend_gcode = Panel("G28 ; home")
merge = Merge(Data1=pre_pend_gcode, Data2=cnc_gcode_3_axis, Data3=post_pend_gcode)
panel_3 = Panel(merge)
