# Grasshopper definition 3_axis_VERTICAL_ATTACK__GCODE_GENERATOR_template.gh (Grasshopper 0.9.76)

pt = Point([Point(-0.01801526661, -0.06060964444, 0), Point(-7, 10, 0), Point(4, 8, 0), Point(6, 11, 0), Point(10, 1, 0), Point(-4, 5, 0), Point(-3, 1, 0), Point(-8, -1.653605625, 0), Point(-3, -6, 0), Point(-1, -6, 0), Point(3, -4, 0), Point(2, -1, 0), Point(6, 0, 0)])  # disabled
pt_2 = Point([Point(-0.01801526661, -0.06060964444, 0), Point(-7, 10, 0), Point(4, 8, 0), Point(6, 11, 0), Point(10, 1, 0), Point(-4, 5, 0), Point(-3, 1, 0), Point(-8, -1.653605625, 0), Point(-3, -6, 0), Point(-1, -6, 0), Point(3, -4, 0), Point(2, -1, 0), Point(6, 0, 0)])
pline = PolyLine(Vertices=pt_2, Closed=False)
pline_2 = PolyLine(Vertices=pt, Closed=False)  # disabled
lng = ListLength(List=pt_2)
depth = Slider(-2, range=-10..-1)  # disabled
panel = Panel(lng)
explode = Explode(Curve=pline, Recursive=True)  # -> Segments, Vertices
explode_2 = Explode(Curve=pline_2, Recursive=True)  # -> Segments, Vertices; disabled
number_slider = Slider(1, range=0..1)  # disabled
cp = ControlPoints(Curve=explode.Segments)  # -> Points, Weights, Knots
cp_2 = ControlPoints(Curve=explode_2.Segments)  # -> Points, Weights, Knots; disabled
item = ListItem(List=cp.Points, Index=Slider(1, range=0..1), Wrap=True)
item_2 = ListItem(List=cp_2.Points, Index=number_slider, Wrap=True)  # disabled
Z = UnitZ(Factor=depth)  # disabled
_1_last_position = Slider(-1, range=-10..0)  # disabled
number_slider_2 = Slider(1, range=0..1)  # disabled
order = PointOrder(Points=cp.Points)
viewer = ParamViewer(item)
move = Move(Geometry=item_2, Motion=Z)  # -> Geometry, Transform; disabled
order_2 = PointOrder(Points=cp_2.Points)  # disabled
before_inserting_the_depth_points = Panel(cp.Points)
before_inserting_the_depth_points_2 = Panel(cp_2.Points)  # disabled
lng_2 = ListLength(List=viewer)
panel_2 = Panel(lng_2)

# ---- group: randomized depths
dom = ConstructDomain(DomainStart=Slider(-1, range=-10..0), DomainEnd=Slider(-4, range=-10..0))
random = Random(Range=dom, Number=panel_2, Seed=2)  # -> graft(Random)

# ----
ins = InsertItems(List=cp_2.Points, Item=move.Geometry, Indices=_1_last_position, Wrap=True)  # -> flatten(List); disabled
after_inserting_the_depth_points_and_fla = Panel(ins)  # "after inserting the depth points and flattening the data tree"; disabled
order_3 = PointOrder(Points=ins)  # disabled
_1_last_position_2 = Slider(-1, range=-10..0)
Z_2 = UnitZ(Factor=random)
move_2 = Move(Geometry=item, Motion=Z_2)  # -> Geometry, Transform
ins_2 = InsertItems(List=cp.Points, Item=move_2.Geometry, Indices=_1_last_position_2, Wrap=True)  # -> flatten(List)
after_inserting_the_depth_points_and_fla_2 = Panel(ins_2)  # "after inserting the depth points and flattening the data tree"
order_4 = PointOrder(Points=ins_2)
