# Grasshopper definition 4_axis_GCODE_GENERATOR_template.gh (Grasshopper 0.9.76)

resolution = Slider(80, range=0..500)
layer_height = Slider(1.5, range=0..5)
layers = Slider(20, range=0..100)
xy = XYPlane(Origin=Point(0, 0, 0))
pi = Pi(Factor=2)
dom = ConstructDomain(DomainStart=0, DomainEnd=pi)
range = Range(Domain=dom, Steps=resolution)
series = Series(Start=0, Step=layer_height, Count=layers)  # -> simplify(graft(Series))
panel = Panel(series)
pt = PointCylindrical(BasePlane=xy, Angle=range, Radius=Slider(30, range=0..100), Elevation=series)  # -> simplify(Point)
order = PointOrder(Points=pt)

flowrate_factor = Slider(0.35, range=0..1)

pline = PolyLine(Vertices=pt, Closed=False)  # -> simplify(Polyline)
explode = Explode(Curve=pline, Recursive=True)  # -> Segments, Vertices
len = Length(Curve=explode.Segments)  # -> simplify(Length)
panel_2 = Panel(len)
multiplication = Multiplication(A=panel_2, B=flowrate_factor)
panel_3 = Panel(multiplication)

# ---- group: get the cords of each point
deconstruct = Deconstruct(Point=pt)  # -> XComponent, YComponent, ZComponent

# ---- group: only two decimals
max_decimal_places = Slider(2, range=0..10)
eval = Evaluate(F="Round(x,y)", x=deconstruct.XComponent, y=max_decimal_places)
eval_2 = Evaluate(F="Round(x,y)", x=deconstruct.YComponent, y=max_decimal_places)
eval_3 = Evaluate(F="Round(x,y)", x=deconstruct.ZComponent, y=max_decimal_places)
eval_4 = Evaluate(F="Round(x,y)", x=multiplication, y=max_decimal_places)

# ---- group: take the coords and produce a gcode line in text format
addition = Addition(A=eval_3, B=1.25)
panel_4 = Panel("G0 or G1 ?")
format = Format(Format="G1 X{0} Y{1} Z{2} E{3}", Culture=127, Data0=eval, Data1=eval_2, Data2=addition, Data3=eval_4)

# ----
txt = Text("G1 F")
int = Integer(Slider(600, range=0..2000))
post_pend_gcode = Panel("G28")
concat = Concatenate(FragmentC="G92 E0")
concat_2 = Concatenate(FragmentA=txt, FragmentB=int)
concat_3 = Concatenate(FragmentA=format, FragmentB=concat)  # -> flatten(Result)
merge = Merge(Data1=post_pend_gcode, Data2=concat_2, Data4=flatten(concat_3), Data5=post_pend_gcode)
panel_5 = Panel(merge)
