# Grasshopper definition 4_axis_PASTE(no heaters)_3Dprinter_GCODE_GENERATOR_template.gh (Grasshopper 0.9.80)

# ---- group: generate a toolpath
resolution = Slider(169, range=0..500)
layer_height = Slider(2, range=0..5)
layers = Slider(29, range=0..100)
xy = XYPlane(Origin=Point(0, 0, 0))
pi = Pi(Factor=2)
dom = ConstructDomain(DomainStart=0, DomainEnd=pi)
range = Range(Domain=dom, Steps=resolution)
series = Series(Start=0, Step=layer_height, Count=layers)  # -> simplify(graft(Series))
pt = PointCylindrical(BasePlane=xy, Angle=range, Radius=Slider(44, range=0..100), Elevation=series)  # -> simplify(Point)
panel = Panel(series)

# ---- group: get the cords of each point
deconstruct = Deconstruct(Point=pt)  # -> XComponent, YComponent, ZComponent

# ---- group: just for previewing the toolpath
order = PointOrder(Points=pt)

# ----
flowrate_factor = Slider(1.59, range=0..2)

# ---- group: calculate distance between adjecent points (for extrussion)
pline = PolyLine(Vertices=pt, Closed=False)  # -> simplify(Polyline)
explode = Explode(Curve=pline, Recursive=True)  # -> Segments, Vertices
merge = Merge(Data1=explode.Segments)
len = Length(Curve=merge)  # -> simplify(Length)
panel_2 = Panel(len)
multiplication = Multiplication(A=len, B=flowrate_factor)

# ----
max_decimal_places = Slider(2, range=0..10)
eval = Evaluate(F="Round(x,y)", x=deconstruct.YComponent, y=max_decimal_places)
eval_2 = Evaluate(F="Round(x,y)", x=deconstruct.ZComponent, y=max_decimal_places)
eval_3 = Evaluate(F="Round(x,y)", x=deconstruct.XComponent, y=max_decimal_places)
eval_4 = Evaluate(F="Round(x,y)", x=multiplication, y=max_decimal_places)

# ---- group: take the coords and produce a gcode line in text format
addition = Addition(A=eval_2, B=1.25)
format = Format(Format="G1 X{0} Y{1} Z{2} E{3}", Culture=127, Data0=eval_3, Data1=eval, Data2=addition, Data3=eval_4)

# ---- group: reset 4th axis (extruder) to zero after every extruded segment
concat = Concatenate(FragmentC="G92 E0")
concat_2 = Concatenate(FragmentA=format, FragmentB=concat)  # -> flatten(Result)

# ----
post_pend_gcode_home_at_start_and_end = Panel("G28")

# ---- group: pre-pend gcode
txt = Text("G1 F")
int = Integer(Slider(2000, range=0..3000))
concat_3 = Concatenate(FragmentA=txt, FragmentB=int)

# ----
merge_2 = Merge(
    Data1=post_pend_gcode_home_at_start_and_end,
    Data2=concat_3,
    Data4=flatten(concat_2),
    Data5=post_pend_gcode_home_at_start_and_end)
panel_3 = Panel(merge_2)
