# Grasshopper definition basic_nodes.gh (Grasshopper 0.9.76)

multiplication = Multiplication()  # disabled
addition = Addition()  # disabled
lng = ListLength()  # disabled
cull = CullPattern(CullPattern=[False, False, True, True])  # disabled
crv = Curve()  # disabled
flatten = FlattenTree(Path="{0}")  # disabled
simplify = SimplifyTree(Front=False)  # disabled
pt = Point()  # disabled
graft = GraftTree(IncludeEmptyLists=True, IncludeNullItems=True)  # disabled
sqgrid = Square(Plane=PlaneXY(0, 0, 0), Size=1, ExtentX=5, ExtentY=5)  # -> Cells, Points; disabled
xz = XZPlane(Origin=Point(0, 0, 0))  # disabled
pt_2 = ConstructPoint(XCoordinate=0, YCoordinate=0, ZCoordinate=0)  # disabled
subtraction = Subtraction()  # disabled
division = Division()  # disabled
item = ListItem(Index=0, Wrap=True)  # disabled
number_slider = Slider(0.25, range=0..1)  # disabled
pdecon = Deconstruct()  # -> XComponent, YComponent, ZComponent; disabled
trigrid = Triangular(Plane=PlaneXY(0, 0, 0), Size=1, ExtentX=5, ExtentY=5)  # -> Cells, Points; disabled
ins = InsertItems(Wrap=True)  # disabled
flip = FlipMatrix()  # disabled
merge = Merge()  # disabled
path_mapper = PathMapper()  # disabled
pop2d = Populate2D(Region={Plane=PlaneXY(0, 0, 0), Size=Domain2(u=0..20, v=0..10)}, Count=100, Seed=1)  # disabled
dom = ConstructDomain(DomainStart=0, DomainEnd=1)  # disabled
pt_3 = PointCylindrical(BasePlane=PlaneXY(0, 0, 0), Angle=0, Radius=1, Elevation=0)  # disabled
eval = Evaluate()  # disabled
series = Series(Start=0, Step=1, Count=10)  # disabled
range = Range(Domain=dom, Steps=10)  # disabled
repeat = RepeatData()  # disabled
pi = Pi(Factor=1)  # disabled
viewer = ParamViewer()  # disabled
cos = Cosine(Value=pi)  # disabled
pline = PolyLine(Closed=False)  # disabled
scale = Scale(Center=Point(0, 0, 0), Factor=0.5)  # -> Geometry, Transform; disabled
circle = CircleCNR(Normal=Vector(0, 0, 1), Radius=1)  # disabled
X = UnitX(Factor=1)  # disabled
hull = ConvexHull(Plane=PlaneXY(0, 0, 0))  # -> Hull, HullZ, Indices; disabled
explode = Explode(Recursive=True)  # -> Segments, Vertices; disabled
points = PointList()  # disabled
vrot = Rotate()  # disabled
cp = ControlPoints()  # -> Points, Weights, Knots; disabled
order = PointOrder()  # disabled
scale_nu = ScaleNU(Plane=PlaneXY(0, 0, 0), ScaleX=1, ScaleY=1, ScaleZ=1)  # -> Geometry, Transform; disabled
con = DelaunayEdges(Plane=PlaneXY(0, 0, 0))  # -> Connectivity, Edges; disabled
end = EndPoints()  # -> Start, End; disabled
len = Length()  # disabled
rotate = Rotate(Angle=1.570796327, Plane=PlaneXY(0, 0, 0))  # -> Geometry, Transform; disabled
voronoi = Voronoi(BruteForceOverride=False)  # disabled
eval_2 = EvaluateCurve()  # -> Point, Tangent, Angle; disabled
move = Move(Motion=Vector(0, 0, 10))  # -> Geometry, Transform; disabled
divide = DivideCurve(Count=10, Kinks=False)  # -> Points, Tangents, Parameters; disabled
metaball = MetaBall(Plane=PlaneXY(0, 0, 0))  # disabled
