# Grasshopper definition gh_template_recipes.gh (Grasshopper 0.9.76)

number_slider = Slider(10, range=0..10)
panel = Panel("""1
2
3
a
b
c""")
panel_2 = Panel("""0
5""")
panel_3 = Panel("""1
2
3
a
b
c""")
panel_4 = Panel("""1
2
3
4""")
panel_5 = Panel("""1
2
3
a
b
c""")
panel_6 = Panel("""0
1
1.5
2""")
xy = XYPlane(Origin=Point(0, 0, 0))
number_slider_2 = Slider(40, range=0..100)
xy_2 = XYPlane(Origin=Point(0, 0, 0))
# right click > internalize data
crv = Curve(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)
pop2d = Populate2D(Region={Plane=PlaneXY(0, 0, 0), Size=Domain2(u=0..20, v=0..10)}, Count=100, Seed=1)
number_slider_3 = Slider(20, range=0..100)
radgrid = Radial(Plane=PlaneXY(0, 0, 0), Size=1, ExtentR=5, ExtentP=20)  # -> Cells, flatten(Points)
xy_3 = XYPlane(Origin=Point(0, 0, 0))
# right click > multiline data
panel_7 = Panel("""@
#""")
pt = Point(radgrid.Points)
sqgrid = Square(Plane=xy_3, Size=1, ExtentX=number_slider, ExtentY=number_slider)  # -> Cells, Points
lng = ListLength(List=panel)
cull_i = CullIndex(List=panel_3, Indices=panel_4, Wrap=True)
cull_i_2 = CullIndex(List=panel_5, Indices=panel_2, Wrap=True)
panel_8 = Panel(Slider(0.25, range=0..1))
pdecon = Deconstruct(Point=radgrid.Points)  # -> XComponent, YComponent, ZComponent
dom = ConstructDomain(DomainStart=Slider(0, range=0..1), DomainEnd=Slider(1, range=0..1))
series = Series(Start=Slider(1, range=0..1), Step=Slider(0.25, range=0..1), Count=Slider(5, range=0..10))
repeat = RepeatData(Data=panel_6, Length=Slider(20, range=0..100))
pi = Pi(Factor=Slider(2, range=0..10))
pi_2 = Pi(Factor=Slider(6, range=0..10))
divide = DivideCurve(Curve=crv, Count=Slider(50, range=0..100), Kinks=False)  # -> Points, Tangents, Parameters
lng_2 = ListLength(List=pt)
series_2 = Series(Start=0, Step=Slider(2, range=0..10), Count=10)
# right click (on input) >
# expression
dom_2 = ConstructDomain(DomainStart=expr("-x", number_slider_3), DomainEnd=number_slider_3)
dom_3 = ConstructDomain(DomainStart=0, DomainEnd=Slider(0.8, range=0..1))
panel_9 = Panel(cull_i)
panel_10 = Panel(cull_i_2)
range = Range(Domain=dom, Steps=Slider(5, range=0..10))
panel_11 = Panel(lng)
panel_12 = Panel(repeat)
panel_13 = Panel(series)
ins = InsertItems(List=panel, Item=panel_7, Indices=Slider(-1, range=-1..2), Wrap=True)
panel_14 = Panel(sqgrid.Points)
# right click > graph type
# right click > edit
image = ImageSampler(
    sqgrid.Points,
    FilePath="C:\Program Files\Rhinoceros 5 (64-bit)\System\rhino_shaded_mode_emap_background.png",
    Filter="Value",
    Interpolate=False,
    Umax=10,
    Umin=0,
    Vmax=10,
    Vmin=0,
    Wrap=1)
pt_2 = Point(divide.Tangents)
Z = UnitZ(Factor=series_2)
# adding some ramdomness to Z values
random = Random(Range=dom_3, Number=lng_2, Seed=2)
Z_2 = UnitZ(Factor=Slider(4, range=0..10))
graph = GraphMapper(range, x0=0, x1=1, y0=0, y1=1, container_name="Conic", Cx=0.3333333433, Cy=0.7536231875)
panel_15 = Panel(ins)
# angle
range_2 = Range(Domain=pi, Steps=number_slider_2)
# periodic elevation
# using trigonometric functions
range_3 = Range(Domain=pi_2, Steps=number_slider_2)
rectangle = Rectangle(Plane=xy_2, XSize=dom_2, YSize=dom_2, Radius=0)  # -> Rectangle, Length
addition = Addition(A=random, B=pdecon.ZComponent)
move = Move(Geometry=divide.Tangents, Motion=Z_2)  # -> Geometry, Transform
merge = Merge(Data1=panel_9, Data2=panel_10)
# double click >
# change param
# viewer mode
viewer = ParamViewer(panel_13)
viewer_2 = ParamViewer(panel_13)
pt_3 = ConstructPoint(XCoordinate=pdecon.XComponent, YCoordinate=pdecon.YComponent, ZCoordinate=addition)
panel_16 = Panel(graph)
move_2 = Move(Geometry=rectangle.Rectangle, Motion=Z)  # -> Geometry, Transform
sin = Sine(Value=range_3)
ln = Line(StartPoint=divide.Points, EndPoint=move.Geometry)
panel_17 = Panel(image)
viewer_3 = ParamViewer(image)
lng_3 = ListLength(List=panel_15)
order = PointOrder(Points=pt_3)
scale = Scale(Geometry=ln, Center=divide.Points, Factor=Slider(0.25, range=0..1))  # -> Geometry, Transform
pt_4 = PointCylindrical(BasePlane=xy, Angle=range_2, Radius=Slider(5, range=0..10), Elevation=sin)
panel_18 = Panel(lng_3)
# right click (on input) >
# expression
rotate = Rotate(Geometry=move_2.Geometry, Angle=expr("x*0.05", series_2), Plane=PlaneXY(0, 0, 0))  # -> Geometry, Transform
# try both rotate configurations
rotate_2 = Rotate(Geometry=move_2.Geometry, Angle=Slider(1, range=0..1), Plane=PlaneXY(0, 0, 0))  # -> Geometry, Transform
end = EndPoints(Curve=scale.Geometry)  # -> Start, End
item = ListItem(List=panel_15, Index=Slider(3, range=0..10), Wrap=True)
order_2 = PointOrder(Points=pt_4)
pt_5 = Point(end.End)
pt_6 = Point(end.Start)
panel_19 = Panel(item)
cp = ControlPoints(Curve=rotate.Geometry)  # -> Points, Weights, Knots
multiplication = Multiplication(A=panel_17, B=Slider(2, range=0..10))
panel_20 = Panel(range_2)
line = LineSDL(Start=sqgrid.Points, Direction=Vector(0, 0, 1), Length=multiplication)
order_3 = PointOrder(Points=cp.Points)
panel_21 = Panel(sin)
viewer_4 = ParamViewer(cp.Points)
flip = FlipMatrix(Data=cp.Points)
pline = PolyLine(Vertices=flip, Closed=False)
viewer_5 = ParamViewer(flip)
cp_2 = ControlPoints(Curve=pline)  # -> Points, Weights, Knots
order_4 = PointOrder(Points=cp_2.Points)
